# Grasshopper definition Len_dimentions.gh (Grasshopper 1.0.8)

curve = Curve([<curve referenced from the Rhino model> x4])
curve_2 = Curve(<curve referenced from the Rhino model>)
text_heights = Slider(3, range=0..100)
flip_curve = FlipCurve(Curve=curve_2)  # -> Curve, Flag
length = Length(Curve=[curve, flip_curve.Curve, curve_2])
annotation_dimension_settings = AnnotationDimensionSettings(ExtensionLineOffset=Slider(3, range=0..10))  # -> DimensionSettings, ViewOriented, TextLocation, TextRotation, RadialViewOriented, RadialTextLocation, RadialTextRotation, DimensionLineExtension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
annotation_text_settings = AnnotationTextSettings(TextHeight=text_heights)  # -> TextSettings, Font, TextHeight, TextGap, MaskFrame, MaskColour, MaskMargins, ViewOriented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
end_points = EndPoints(Curve=[flip_curve.Curve, curve])  # -> Start, End
round = Round(Number=length)  # -> Nearest, Floor, Ceiling
aligned_dimension = AlignedDimension(
    PointA=end_points.End,
    PointB=end_points.Start,
    Offset=Slider(6.2, range=0..10),
    TextOverride=round.Floor,
    TextSettings=annotation_text_settings.TextSettings,
    DimensionSettings=annotation_dimension_settings.DimensionSettings)  # -> AlignedDimension, PointA, PointB, Offset, Plane, TextOverride, TextSettings, DimensionSettings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
