# Grasshopper definition autonest.gh (Grasshopper 1.0.8)
# plug-ins: opennest_2 Info

curve = Curve(<curve referenced from the Rhino model>)
curve_2 = Curve([<curve referenced from the Rhino model> x16])
opennest1 = OpenNest1(
    Sheets=curve,
    Geo=curve_2,
    Spacing="0",
    Placement=Slider(3, range=0..3),
    Tolerance=0.1,
    Rotations=Slider(4, range=1..4),
    Iterations="10",
    Seed=Slider(13, range=0..100),
    Reset=Button(),
    Run=Toggle(True))  # -> Sheets, Geo, ID, Transform, IDS
curve_3 = Curve(flatten(opennest1.Geo))
