# Grasshopper definition autonest_v2.gh (Grasshopper 1.0.8)
# plug-ins: opennest_2 Info

parts = Geometry([<curve referenced from the Rhino model> x47, <textentity referenced from the Rhino model>, <curve referenced from the Rhino model> x224, <textentity referenced from the Rhino model>, <curve referenced from the Rhino model> x2])
panelgroups = GhPythonScript(Parts=parts)  # -> out, Cut, Ids; inputs Parts: tree
# ---------- panelgroups: Python ----------
# -*- coding: utf-8 -*-
"""PanelGroups — GhPython component for autonest_v2.gh.

Panels come grouped in Rhino: one CUT (closed curve on layer CUT) + its INT,
INK, texts… Only the CUTs go to OpenNest; the rest of each group goes with
its CUT after nesting (CarryInside).

Inputs:
    Parts : the grouped panels referenced from Rhino (Set Multiple — a window
            over the groups is enough: a CUT brings its whole group), Tree access
Outputs:
    Cut   : the CUT of each panel, one per branch {i} — to OpenNest Geo
    Ids   : branch {i}: the CUT's id, then every other member of its group(s)
            — to CarryInside
"""


def panels(objs, is_cut, groups_of, members):
    """objs (ids, input order) → ([[cut, member…] per CUT], loose objs, CUTs sharing a group with another CUT)."""
    parts, shared, taken = [], [], set()
    for c in [o for o in objs if is_cut(o)]:
        mates = []
        for g in groups_of(c):
            for m in members(g):
                if m != c and m not in mates:
                    mates.append(m)
        if any(is_cut(m) for m in mates):
            shared.append(c)
        parts.append([c] + [m for m in mates if not is_cut(m)])
        taken.update(parts[-1])
    return parts, [o for o in objs if o not in taken], shared


if "ghenv" in globals():
    import Rhino
    import Grasshopper
    from Grasshopper import DataTree
    from Grasshopper.Kernel.Data import GH_Path

    comp = ghenv.Component
    rdoc = Rhino.RhinoDoc.ActiveDoc
    warn = lambda text: comp.AddRuntimeMessage(Grasshopper.Kernel.GH_RuntimeMessageLevel.Warning, text)
    ids = []
    for g in comp.Params.Input[0].VolatileData.AllData(True):
        if g.IsReferencedGeometry and g.ReferenceID not in ids:
            ids.append(g.ReferenceID)

    def is_cut(i):
        o = rdoc.Objects.FindId(i)
        return (o is not None and isinstance(o.Geometry, Rhino.Geometry.Curve) and o.Geometry.IsClosed
                and rdoc.Layers[o.Attributes.LayerIndex].FullPath.split("::")[0].upper() == "CUT")

    parts, loose, shared = panels(
        ids, is_cut,
        lambda i: list(rdoc.Objects.FindId(i).Attributes.GetGroupList() or []),
        lambda g: [o.Id for o in rdoc.Groups.GroupMembers(g)])

    Cut, Ids = DataTree[object](), DataTree[object]()
    for n, part in enumerate(parts):
        Cut.Add(rdoc.Objects.FindId(part[0]).Geometry.Duplicate(), GH_Path(n))
        for i in part:
            Ids.Add(str(i), GH_Path(n))
    if not parts:
        comp.AddRuntimeMessage(Grasshopper.Kernel.GH_RuntimeMessageLevel.Error, "no closed curve on layer CUT in Parts")
    if loose:
        warn("%d object(s) not in a group with a CUT — left out" % len(loose))
    if shared:
        warn("%d CUT(s) share a group with another CUT — both get its members" % len(shared))
    comp.Message = "%d panels" % len(parts)


if __name__ == "__main__" and "ghenv" not in globals():
    layer = {"c1": "CUT", "c2": "CUT", "c3": "CUT", "i1": "INT", "k1": "INK", "x": "INK", "k3": "INK"}
    groups = {"c1": [0], "i1": [0, 5], "k1": [0], "c2": [], "c3": [7], "k3": [7]}
    members = {0: ["c1", "i1", "k1"], 5: ["i1"], 7: ["c3", "k3"]}
    p, loose, shared = panels(["i1", "c1", "c2", "x", "c3"], lambda o: layer[o] == "CUT",
                              lambda o: groups.get(o, []), lambda g: members[g])
    assert p == [["c1", "i1", "k1"], ["c2"], ["c3", "k3"]], p   # k1 / k3 not selected — come with their group
    assert loose == ["x"] and shared == []
    p, loose, shared = panels(["c1", "c3"], lambda o: o.startswith("c"),
                              lambda o: [0], lambda g: ["c1", "c3", "i1"])
    assert shared == ["c1", "c3"] and p[0] == ["c1", "i1"]
    print("ok")
# ---------- end panelgroups ----------
curve = Curve(flatten(panelgroups.Cut))
from = Slider(1, range=0..1000)
count = Slider(101, range=1..500)
minutes = Slider(0, range=0..120)
curve_2 = Curve(<curve referenced from the Rhino model>)
run = BooleanToggle(False)
tol_cm = Panel("1")
opennest1 = OpenNest1(
    Sheets=curve_2,
    Geo=curve,
    Spacing="0",
    Placement=Slider(3, range=0..3),
    Tolerance=0.1,
    Rotations=Slider(4, range=1..4),
    Iterations=Slider(310, range=0..1000),
    Seed=Slider(40, range=1..100),
    Reset=Button(),
    Run=Toggle(True))  # -> Sheets, Geo, ID, Transform, IDS
seedsearch = GhPythonScript(Geo=opennest1.Geo, Run=run, From=from, Count=count, Minutes=minutes, Tol=tol_cm)  # -> out, Seed, L, A, Table; inputs Geo: tree
# ---------- seedsearch: Python ----------
# -*- coding: utf-8 -*-
"""SeedSearch — GhPython component for autonest_v2.gh.

Tries OpenNest2 seeds one after another and keeps the layout that takes the
least material along X; among the shortest (within Tol) — the smallest
bounding box area. OpenNest2 runs its generations over many solutions, so
Galapagos can't score it; this component waits for each result ("fit …").

Inputs:
    Geo     : Geo output of OpenNest, Tree access (only to be solved when it changes;
              the layout is read from OpenNest itself)
    Run     : Boolean Toggle — True starts a new search, False stops it
    From    : first seed (default 1)
    Count   : how many seeds (default 50)
    Minutes : time limit, 0 — none
    Tol     : cm — lengths within Tol count as equally short (default 1)
Outputs:
    Seed    : best seed (set on the Seed slider at the end)
    L       : its length along X, cm
    A       : its bounding box area, m²
    Table   : "seed  L cm  A m²" per tried seed, best first
"""


def pick(results, tol):
    """(seed, length, area) list → best one: shortest within tol, then least area."""
    if not results:
        return None
    short = min(r[1] for r in results)
    return min((r for r in results if r[1] <= short + tol), key=lambda r: (r[2], r[1]))


def table(results, tol):
    best = pick(results, tol)
    rows = sorted(results, key=lambda r: (r[1], r[2]))
    rows.remove(best)
    return ["%d  %.1f cm  %.3f m2" % r for r in [best] + rows]


if "ghenv" in globals():
    import time
    import System
    import Rhino
    import scriptcontext as sc
    import Grasshopper

    comp = ghenv.Component
    gd = comp.OnPingDocument()
    st = sc.sticky.setdefault("SeedSearch.%s" % comp.InstanceGuid, {"on": False, "run": False, "seeds": [], "results": []})
    From = 1 if From is None else int(From)
    Count = int(Count or 50)
    Minutes = float(Minutes or 0)
    Tol = 1.0 if Tol is None else float(Tol)
    cm = Rhino.RhinoMath.UnitScale(Rhino.RhinoDoc.ActiveDoc.ModelUnitSystem, Rhino.UnitSystem.Centimeters)

    nest = next((o for o in (s.Attributes.GetTopLevel.DocObject for s in comp.Params.Input[0].Sources)
                 if o.GetType().FullName.endswith("component_nest1")), None)
    inp = dict((p.Name, p) for p in nest.Params.Input) if nest else {}
    slider = inp["Seed"].Sources[0] if nest and inp["Seed"].Sources else None
    if not isinstance(slider, Grasshopper.Kernel.Special.GH_NumberSlider):
        comp.AddRuntimeMessage(Grasshopper.Kernel.GH_RuntimeMessageLevel.Error,
                               "Geo must come from OpenNest, its Seed from a Number Slider")
    else:
        def measure():
            """(length, area) of the finished layout in cm / m², None while OpenNest is busy."""
            if not (nest.Message or "").startswith("fit"):
                return None
            box = Rhino.Geometry.BoundingBox.Empty
            for g in nest.Params.Output[1].VolatileData.AllData(True):
                box.Union(g.Boundingbox)
            if not box.IsValid:
                return None
            x0 = min(g.Boundingbox.Min.X for g in inp["Sheets"].VolatileData.AllData(True))
            length = (box.Max.X - x0) * cm
            return length, length * (box.Max.Y - box.Min.Y) * cm / 1e4

        def set_seed(value):
            """Seed on the slider at the next solution; the result on screen is not its own until OpenNest restarts."""
            st["fresh"] = False
            def cb(doc):
                v = System.Decimal(value)
                slider.Slider.Maximum = max(slider.Slider.Maximum, v)
                slider.Slider.Minimum = min(slider.Slider.Minimum, v)
                slider.SetSliderValue(v)
                slider.ExpireSolution(False)
            gd.ScheduleSolution(5, Grasshopper.Kernel.GH_Document.GH_ScheduleDelegate(cb))

        def stop():
            st["run"] = False
            if st["results"]:
                set_seed(pick(st["results"], Tol)[0])

        if Run and not st["on"]:
            st.update(run=True, seeds=list(range(From, From + Count)), results=[], t0=time.time())
            if int(slider.CurrentValue) == From:
                st["fresh"] = True
            else:
                set_seed(From)
        elif not Run and st["on"] and st["run"]:
            stop()
        st["on"] = bool(Run)

        # ponytail: no per-seed timeout — if OpenNest never prints "fit" the search waits; Run off stops it
        if st["run"] and int(slider.CurrentValue) == st["seeds"][0]:
            done = measure()
            if done is None:
                st["fresh"] = True
            elif st["fresh"]:
                st["results"].append((st["seeds"].pop(0),) + done)
                if st["seeds"] and not (Minutes and time.time() - st["t0"] > Minutes * 60):
                    set_seed(st["seeds"][0])
                else:
                    stop()

        n = len(st["results"])
        if n:
            Seed, L, A = pick(st["results"], Tol)
            Table = table(st["results"], Tol)
        comp.Message = ("%s %d/%d" % ("seed" if st["run"] else "done", n, n + len(st["seeds"])) if st["seeds"] or n
                        else "Run = True") + ("  best %d" % Seed if n else "")


if __name__ == "__main__" and "ghenv" not in globals():
    r = [(1, 1500.0, 30.0), (2, 1439.2, 29.8), (3, 1439.9, 28.0), (4, 1441.0, 20.0)]
    assert pick(r, 1.0)[0] == 3       # 1439.9 within 1 cm of the shortest, smaller area
    assert pick(r, 0.5)[0] == 2       # only the shortest
    assert pick(r, 2.0)[0] == 4
    assert pick([], 1.0) is None
    assert table(r, 1.0)[0].startswith("3 ")
    print("ok")
# ---------- end seedsearch ----------
curve_3 = Curve(flatten(opennest1.Geo))
seeds = Panel(seedsearch.Table)
bake = Button()
carryinside = GhPythonScript(Ids=panelgroups.Ids, X=opennest1.Transform, Bake=bake)  # -> out, CUT, INK, INT, Other, N; inputs Ids: tree, X: tree
# ---------- carryinside: Python ----------
# -*- coding: utf-8 -*-
"""CarryInside — GhPython component for autonest_v2.gh.

Each panel (a Rhino group: CUT + INT, INK, texts…, from PanelGroups) goes to
its nested place: the CUT's own OpenNest transform is applied to a copy of
every member.

A CUT that doesn't fit OpenNest puts on an extra copy of the sheet (IDS ≥
number of sheets): it is left out with a warning, the message counts the
placed ones ("11/12 placed").

Inputs:
    Ids  : Ids output of PanelGroups — branch {i}: CUT id, then the rest of
           its group (Tree access)
    X    : Transform output of OpenNest (Tree access)
    Bake : Button — copies (CUT + its group) added to the Rhino document with
           their own layer / colour / linetype, one group per panel, one undo
Outputs (one per layer, to bake each into its layer; branch {i} = panel i):
    CUT   : moved CUT copies
    INK   : moved copies from layer INK
    INT   : moved copies from layer INT
    Other : moved copies from any other layer
    N     : "<panel>: <objects with its CUT>" per panel
"""


def find_nest(param):
    """OpenNest that feeds param, through relays."""
    for s in param.Sources:
        o = s.Attributes.GetTopLevel.DocObject
        if o.GetType().FullName.endswith("component_nest1"):
            return o
        if hasattr(o, "Sources"):
            o = find_nest(o)
            if o:
                return o
    return None


if "ghenv" in globals():
    import System
    import Rhino
    import Grasshopper
    from Grasshopper import DataTree
    from Grasshopper.Kernel.Data import GH_Path

    LAYERS = ["CUT", "INK", "INT", "Other"]
    comp = ghenv.Component
    rdoc = Rhino.RhinoDoc.ActiveDoc
    idata = comp.Params.Input[0].VolatileData
    parts = [[o for o in (rdoc.Objects.FindId(System.Guid(str(g))) for g in idata.Branches[n]) if o]
             for n in range(idata.PathCount)]
    xdata = comp.Params.Input[1].VolatileData
    xforms = [list(xdata.Branches[i]) if i < xdata.PathCount else [] for i in range(len(parts))]
    nest = find_nest(comp.Params.Input[1])
    off = set()
    if nest:
        sheet_of = nest.Params.Output[4].VolatileData
        sheets = nest.Params.Input[0].VolatileDataCount
        off = set(i for i in range(min(len(parts), sheet_of.PathCount))
                  if sheet_of.Branches[i].Count and sheet_of.Branches[i][0].Value >= sheets)

    if not parts:
        comp.AddRuntimeMessage(Grasshopper.Kernel.GH_RuntimeMessageLevel.Error, "Ids must come from PanelGroups")
    elif any(xforms):
        out = dict((k, DataTree[object]()) for k in LAYERS)
        N = ["%d: %d" % (i, len(part) - 1) for i, part in enumerate(parts)]
        placed = inside = 0
        if Bake:
            rec = rdoc.BeginUndoRecord("CarryInside bake")
        for i, part in enumerate(parts):
            if len(xforms[i]) != 1 or i in off:
                comp.AddRuntimeMessage(Grasshopper.Kernel.GH_RuntimeMessageLevel.Warning,
                                       "Cut %d didn't fit the sheet — left out" % i)
                continue
            placed += 1
            inside += len(part) - 1
            group = rdoc.Groups.Add() if Bake else None
            for obj in part:
                g = obj.Geometry.Duplicate()
                g.Transform(xforms[i][0].Value)
                top = rdoc.Layers[obj.Attributes.LayerIndex].FullPath.split("::")[0].upper()
                out[top if top in LAYERS else "Other"].Add(g, GH_Path(i))
                if Bake:
                    a = obj.Attributes.Duplicate()
                    a.RemoveFromAllGroups()
                    a.AddToGroup(group)
                    rdoc.Objects.Add(g, a)
        if Bake:
            rdoc.EndUndoRecord(rec)
            rdoc.Views.Redraw()
        CUT, INK, INT, Other = [out[k] for k in LAYERS]
        comp.Message = "%d/%d placed, %d with them" % (placed, len(parts), inside)


if __name__ == "__main__" and "ghenv" not in globals():
    class P(object):                         # find_nest through a relay
        def __init__(self, name, sources=()):
            self.Sources = list(sources)
            self.Attributes = self
            self.GetTopLevel = self
            self.DocObject = self
            self.name = name
        def GetType(self):
            return self
        @property
        def FullName(self):
            return self.name
    nest = P("opennest_2.component_nest1")
    assert find_nest(P("x", [P("Relay", [nest])])) is nest
    assert find_nest(P("x", [P("Relay")])) is None
    print("ok")
# ---------- end carryinside ----------
geometry = Geometry(curve_3)
