# Grasshopper definition bounding_dimensions.gh (Grasshopper 1.0.8)
# plug-ins: Pufferfish, opennest_2 Info

# ---- group: MAX DIMMENSIONS
# Bounding Dimm
geometry = Geometry(graft([<curve referenced from the Rhino model> x11]))
panel = Panel(geometry)
bounding_box = BoundingBox(Content=geometry, Plane=PlaneXY(0, 0, 0))  # -> Box, Box_2
panel_2 = Panel(bounding_box.Box)
box_corners = BoxCorners(Box=bounding_box.Box)  # -> CornerA, CornerB, CornerC, CornerD, CornerE, CornerF, CornerG, CornerH
line = Line(StartPoint=box_corners.CornerA, EndPoint=box_corners.CornerB)
line_2 = Line(StartPoint=box_corners.CornerB, EndPoint=box_corners.CornerC)
end_points = EndPoints(Curve=[line, line_2])  # -> Start, End
line_3 = Line(StartPoint=end_points.Start, EndPoint=end_points.End)
length = Length(Curve=line_3)
round = Round(Number=length)  # -> Nearest, Floor, Ceiling
aligned_dimension = AlignedDimension(
    Plane=PlaneXY(0, 0, 0),
    PointA=end_points.Start,
    PointB=end_points.End,
    Offset=Slider(-516, range=-1000..1),
    Text=round.Nearest,
    Size=Slider(105, range=0..1000))

# ---- group: ZIPs MEasuring
# ZIPs Length
curve = Curve([<curve referenced from the Rhino model> x10])
length_2 = Length(Curve=curve)
panel_3 = Panel(length_2)
end_points_2 = EndPoints(Curve=curve)  # -> Start, End
round_2 = Round(Number=panel_3)  # -> Nearest, Floor, Ceiling
panel_4 = Panel(round_2.Nearest)
sort_list = SortList(Keys=panel_4)  # -> Keys, ValuesValuesA
aligned_dimension_2 = AlignedDimension(
    Plane=PlaneXY(0, 0, 0),
    PointA=end_points_2.Start,
    PointB=end_points_2.End,
    Offset=Slider(-97, range=-1000..1),
    Text=round_2.Nearest,
    Size=Slider(113, range=0..1000))
panel_5 = Panel(sort_list.Keys)

# ----
geometry_pipeline = GeometryPipeline(
    GroupByLayer=False,
    GroupByType=False,
    IncludeHidden=True,
    IncludeLocked=True,
    LayerFilter="*_CENTRO",
    NameFilter="*",
    SublayerFiltering=True,
    TypeFilter=4)
geometry_pipeline_2 = GeometryPipeline(
    GroupByLayer=False,
    GroupByType=False,
    IncludeHidden=True,
    IncludeLocked=True,
    LayerFilter="*_FINESTRE",
    NameFilter="*",
    SublayerFiltering=True,
    TypeFilter=4)
geometry_pipeline_3 = GeometryPipeline(
    GroupByLayer=False,
    GroupByType=False,
    IncludeHidden=True,
    IncludeLocked=True,
    LayerFilter="*_TAGLI",
    NameFilter="*",
    SublayerFiltering=True,
    TypeFilter=4)
geometry_pipeline_4 = GeometryPipeline(
    GroupByLayer=False,
    GroupByType=False,
    IncludeHidden=True,
    IncludeLocked=True,
    LayerFilter="*_BOTTONI",
    NameFilter="*",
    SublayerFiltering=True,
    TypeFilter=1)
geometry_pipeline_5 = GeometryPipeline(
    GroupByLayer=False,
    GroupByType=False,
    IncludeHidden=True,
    IncludeLocked=True,
    LayerFilter="*_TAGLI",
    NameFilter="*",
    SublayerFiltering=True,
    TypeFilter=1)
geometry_pipeline_6 = GeometryPipeline(
    GroupByLayer=False,
    GroupByType=False,
    IncludeHidden=True,
    IncludeLocked=True,
    LayerFilter="*_TASCA",
    NameFilter="*",
    SublayerFiltering=True,
    TypeFilter=1)
geometry_pipeline_7 = GeometryPipeline(
    GroupByLayer=False,
    GroupByType=False,
    IncludeHidden=True,
    IncludeLocked=True,
    LayerFilter="*_ZIP",
    NameFilter="*",
    SublayerFiltering=True,
    TypeFilter=4)
geometry_pipeline_8 = GeometryPipeline(
    GroupByLayer=False,
    GroupByType=False,
    IncludeHidden=True,
    IncludeLocked=True,
    LayerFilter="*_SRF",
    NameFilter="*",
    SublayerFiltering=True,
    TypeFilter=0)
deconstruct_brep = DeconstructBrep(Brep=geometry_pipeline_8)  # -> flatten(Faces), Edges, Vertices
panel_6 = Panel(geometry_pipeline_5)

# ---- group: to be unrolled
surface = Surface(reparameterize(deconstruct_brep.Faces))
curve_2 = Curve([geometry_pipeline_3, geometry_pipeline_7, geometry_pipeline, geometry_pipeline_2])
point = Point([geometry_pipeline_5, geometry_pipeline_4, geometry_pipeline_6])

# ----
geometry_pipeline_9 = GeometryPipeline(
    GroupByLayer=False,
    GroupByType=False,
    IncludeHidden=True,
    IncludeLocked=True,
    LayerFilter="*_SEAMS_LINE",
    NameFilter="*",
    SublayerFiltering=True,
    TypeFilter=4)
colour_picker = ColourPicker(PickedColour=RGB(102, 255, 0))

options = Options(
    Rotations=Slider(4, range=0..360),
    Wiggle=Slider(0, range=0..5.01),
    PlacementType=Slider(0, range=0..2),
    Spacing=Slider(100, range=0..100),
    Seed=Slider(30, range=0..100),
    SimplifyTolerance=Slider(0.01, range=0.01..10),
    Mutation=Slider(1, range=1..100),
    Population=Slider(1000, range=1..100000),
    Time=Slider(0, range=0..120),
    SheetFont="MecSoft_Font-1 -10")

# ----
# NESTING
curve_3 = Curve([<curve referenced from the Rhino model> x4])
geometry_2 = Geometry(Outlines=curve_3, Simplify=-100, Hull=False)  # -> Geometry, Borders
curve_4 = Curve(<curve referenced from the Rhino model>)
sheets = Sheets(Polylines=curve_4, Gap=0.1, Rows="1", Copies="1")  # -> Sheets, Polylines
opennest2 = OpenNest2(Sheets=sheets.Sheets, Geometry=geometry_2.Geometry, Options=options, Iterations=1, Run=Toggle(True))  # -> Sheets, Borders, AllGeo, Transforms, SheetId, SheetTxt, Attributes

geometry_pipeline_10 = GeometryPipeline(
    GroupByLayer=False,
    GroupByType=False,
    IncludeHidden=True,
    IncludeLocked=True,
    LayerFilter="*2dSEAMS_LINE",
    NameFilter="*",
    SublayerFiltering=True,
    TypeFilter=4)
list_item = ListItem(List=geometry_pipeline_10, Index=0, Wrap=True)
# Batute
flip_curve = FlipCurve(Curve=geometry_pipeline_10, Guide=list_item)  # -> Curve, Flag
number_slider = Slider(10, range=0..10)
end_points_3 = EndPoints(Curve=flip_curve.Curve)  # -> Start, End
divide_distance = DivideDistance(Curve=flip_curve.Curve, Distance=Slider(150, range=0..1000))  # -> Points, Tangents, Parameters
colour_picker_2 = ColourPicker(PickedColour=RGB(102, 255, 0))
cull_index = CullIndex(List=divide_distance.Points, Indices="0", Wrap=True)
center_box = CenterBox(Base=[end_points_3.Start, end_points_3.End], X=number_slider, Y=number_slider, Z=number_slider)  # -> flatten(Box)
sphere = Sphere(Base=cull_index, Radius=number_slider)  # -> flatten(Sphere)
custom_preview = CustomPreview(Geometry=[center_box, sphere], Material=colour_picker_2)
geometry_3 = Geometry([center_box, sphere])

# ----
# UNROLL
plane_surface = PlaneSurface(Plane=PlaneXY(0, 0, 0), XSize=Domain(-10, 10), YSize=Domain(-10, 10))
flip = Flip(Surface=surface, Guide=plane_surface)  # -> Surface, Result
point_2 = Point(point)
merge = Merge(Data1=point_2)

# ----
# Batute
curve_5 = Curve(geometry_pipeline_9)
brep = Brep(graft(surface))
number_slider_2 = Slider(10, range=0..10)
end_points_4 = EndPoints(Curve=geometry_pipeline_9)  # -> Start, End
divide_distance_2 = DivideDistance(Curve=geometry_pipeline_9, Distance=Slider(150, range=0..1000))  # -> Points, Tangents, Parameters
center_box_2 = CenterBox(Base=[end_points_4.Start, end_points_4.End], X=number_slider_2, Y=number_slider_2, Z=number_slider_2)  # -> flatten(Box)

cull_index_2 = CullIndex(List=divide_distance_2.Points, Indices="0", Wrap=True)
sphere_2 = Sphere(Base=cull_index_2, Radius=number_slider_2)  # -> flatten(Sphere)

brep_brep = BrepBrep(BrepA=brep, BrepB=[center_box_2, sphere_2])  # -> flatten(Curves), Points

custom_preview_2 = CustomPreview(Geometry=brep_brep.Curves, Material=colour_picker)

# ---- group: LAYOUT
number_slider_3 = Slider(924, range=0..10000)  # disabled
number_slider_4 = Slider(5480, range=0..10000)  # disabled
xy_plane = XYPlane(Origin=Point(0, 0, 0))  # disabled
unit_x = UnitX(Factor=number_slider_4)  # disabled

# ----
brep_2 = Brep(graft(flip.Surface))
curve_6 = Curve(curve_2)

# ---- group: LAYOUT (continued)
brep_3 = Brep(brep_2)  # disabled
area = Area(Geometry=brep_3)  # -> Area, Centroid; disabled
bounding_box_2 = BoundingBox(Content=flatten(brep_3), Plane=PlaneXY(0, 0, 0), UnionBox=True)  # -> Box, Box_2; disabled
area_2 = Area(Geometry=bounding_box_2.Box)  # -> Area, Centroid; disabled
vector_2pt = Vector2Pt(PointA=area_2.Centroid, PointB=area.Centroid, Unitize=False)  # -> Vector, Length; disabled
amplitude = Amplitude(Vector=vector_2pt.Vector, Amplitude=number_slider_3)  # disabled
move = Move(Geometry=brep_3, Motion=amplitude)  # -> Geometry, Transform; disabled
area_3 = Area(Geometry=move.Geometry)  # -> Area, Centroid; disabled
project = Project(Geometry=area_3.Centroid, Plane=xy_plane)  # -> Geometry, Transform; disabled
move_2 = Move(Geometry=project.Geometry, Motion=unit_x)  # -> Geometry, Transform; disabled

# ----
brep_4 = Brep(brep_2)  # disabled

number_slider_5 = Slider(1000, range=0..1000)  # disabled
panel_7 = Panel("0.5,0.5")  # disabled
evaluate_surface = EvaluateSurface(Surface=reparameterize(brep_4), Point=panel_7)  # -> Point, Normal, UDirection, VDirection, Frame; disabled
unit_y = UnitY(Factor=1)  # disabled
line_sdl = LineSDL(Start=evaluate_surface.Frame, Direction=unit_y, Length=number_slider_5)  # disabled
end_points_5 = EndPoints(Curve=line_sdl)  # -> Start, End; disabled
pull_point = PullPoint(Point=end_points_5.End, Geometry=brep_4, ClosestOnly=True)  # -> ClosestPoint, Distance; disabled

# ---- group: Numbers on 3D model
number_slider_6 = Slider(150, range=0..1000)  # disabled
panel_8 = Panel("0.6,0.6")  # disabled
tree_statistics = TreeStatistics(Tree=brep_4)  # -> Paths, Length, simplify(Count); disabled
evaluate_surface_2 = EvaluateSurface(Surface=reparameterize(brep_4), Point=panel_8)  # -> Point, Normal, UDirection, VDirection, Frame; disabled
unit_x_2 = UnitX(Factor=1)  # disabled
series = Series(Start=0, Step=1, Count=tree_statistics.Count)  # -> graft(Series); disabled
align_plane = AlignPlane(Plane=evaluate_surface_2.Frame, Direction=unit_x_2)  # -> Plane, Angle; disabled
text = Text(Location=align_plane.Plane, Text=series, Size=number_slider_6)  # -> simplify(Curves); disabled

# ----
point_3 = Point(pull_point.ClosestPoint)
unroll_polysurface = UnrollPolysurface(Polysurface=brep_2, Points=point_3)  # -> Unrolled, UnrolledPoints, UnrolledCurves; disabled
area_4 = Area(Geometry=unroll_polysurface.Unrolled)  # -> Area, Centroid
point_4 = Point(unroll_polysurface.UnrolledPoints)
unit_y_2 = UnitY(Factor=1)
vector_2pt_2 = Vector2Pt(PointA=area_4.Centroid, PointB=point_4, Unitize=False)  # -> Vector, Length
angle = Angle(VectorA=vector_2pt_2.Vector, VectorB=unit_y_2, Plane=area_4.Centroid)  # -> simplify(Angle), Reflex

project_2 = Project(Curve=text, Brep=brep_4, Direction=align_plane.Plane)  # -> flatten(Curve); disabled

curve_7 = Curve(project_2)

curve_8 = Curve(brep_brep.Curves)
point_5 = Point(move_2.Geometry)

merge_2 = Merge(Data1=curve_6, Data2=curve_7, Data3=curve_8)
unroll_polysurface_2 = UnrollPolysurface(Polysurface=brep_2, Points=merge, Curves=merge_2)  # -> Unrolled, UnrolledPoints, UnrolledCurves; disabled
deconstruct_brep_2 = DeconstructBrep(Brep=unroll_polysurface_2.Unrolled)  # -> Faces, Edges, Vertices
join_curves = JoinCurves(Curves=deconstruct_brep_2.Edges, Preserve=False)  # -> simplify(Curves)

area_5 = Area(Geometry=join_curves)  # -> Area, Centroid
vector_2pt_3 = Vector2Pt(PointA=area_5.Centroid, PointB=point_5, Unitize=False)  # -> Vector, Length

move_3 = Move(Geometry=join_curves, Motion=vector_2pt_3.Vector)  # -> simplify(Geometry), Transform

point_6 = Point(unroll_polysurface_2.UnrolledPoints)
curve_9 = Curve(unroll_polysurface_2.UnrolledCurves)
transform = Transform(Geometry=curve_9, Transform=move_3.Transform)  # -> simplify(Geometry)
transform_2 = Transform(Geometry=point_6, Transform=move_3.Transform)  # -> simplify(Geometry)

data = Data([transform, transform_2, move_3.Geometry])

area_6 = Area(Geometry=move_3.Geometry)  # -> Area, Centroid
group = Group(Objects=data)
rotate = Rotate(Geometry=group, Angle=angle.Angle, Plane=area_6.Centroid)  # -> Geometry, Transform
bake_unrolled = Data(rotate.Geometry)
