# Grasshopper definition divanno_v1.gh (Grasshopper 1.0.8)

number_slider = Slider(50, range=0..100)
number_slider_2 = Slider(1855, range=0..10000)

number_slider_3 = Slider(350, range=0..1000)
number_slider_4 = Slider(50, range=0..100)

cluster = Cluster(
    x_size=number_slider_2,
    y_size=Slider(540, range=0..1000),
    height=number_slider,
    offset=number_slider,
    x_size_2=number_slider_2,
    y_size_2=number_slider_4,
    height_2=number_slider_3,
    factor=number_slider_4,
    offset_2=number_slider_3,
    value=Slider(136, range=0..1000),
    x_size_3=number_slider_2,
    height_3=Slider(50, range=0..100))  # -> box_2, box, box_3

# ==== cluster Cluster
height = ClusterInput()
x_size = ClusterInput()
y_size = ClusterInput()
height_2 = ClusterInput()
x_size_2 = ClusterInput()
y_size_2 = ClusterInput()
x_size_3 = ClusterInput()
height_3 = ClusterInput()
offset = ClusterInput()
offset_2 = ClusterInput()
value = ClusterInput()
factor = ClusterInput()
negative = Negative(Value=value)
rectangle = Rectangle(Plane=PlaneXY(0, 0, 0), XSize=x_size, YSize=y_size, Radius=0)  # -> Rectangle, Length
plane_offset = PlaneOffset(BasePlane=PlaneXY(0, 0, 0), Offset=offset)
rectangle_2 = Rectangle(Plane=plane_offset, XSize=x_size_2, YSize=y_size_2, Radius=0)  # -> Rectangle, Length
plane_offset_2 = PlaneOffset(BasePlane=plane_offset, Offset=offset_2)
box_rectangle = BoxRectangle(Rectangle=rectangle_2.Rectangle, Height=height_2)
box = ClusterOutput(box_rectangle)
box_rectangle_2 = BoxRectangle(Rectangle=rectangle.Rectangle, Height=height)
box_2 = ClusterOutput(box_rectangle_2)
deconstruct_plane = DeconstructPlane(Plane=plane_offset_2)  # -> Origin, XAxis, YAxis, ZAxis
unit_y = UnitY(Factor=factor)
move = Move(Geometry=deconstruct_plane.Origin, Motion=unit_y)  # -> Geometry, Transform
construct_plane = ConstructPlane(Origin=move.Geometry, XAxis=deconstruct_plane.XAxis, YAxis=Vector(0, 1, 0))
rectangle_3 = Rectangle(Plane=construct_plane, XSize=x_size_3, YSize=negative, Radius=0)  # -> Rectangle, Length
box_rectangle_3 = BoxRectangle(Rectangle=rectangle_3.Rectangle, Height=height_3)
box_3 = ClusterOutput(box_rectangle_3)
