# Grasshopper definition drag.gh (Grasshopper 1.0.8)
# plug-ins: Pufferfish, opennest_2 Info, PTComponentLibrary

geometry_pipeline = GeometryPipeline(
    GroupByLayer=False,
    GroupByType=False,
    IncludeHidden=True,
    IncludeLocked=True,
    LayerFilter="*_TASCA",
    NameFilter="*",
    SublayerFiltering=True,
    TypeFilter=1)
geometry_pipeline_2 = GeometryPipeline(
    GroupByLayer=False,
    GroupByType=False,
    IncludeHidden=True,
    IncludeLocked=True,
    LayerFilter="*_bottoni",
    NameFilter="*",
    SublayerFiltering=True,
    TypeFilter=1)
geometry_pipeline_3 = GeometryPipeline(
    GroupByLayer=False,
    GroupByType=False,
    IncludeHidden=True,
    IncludeLocked=True,
    LayerFilter="*_TAGLI",
    NameFilter="*",
    SublayerFiltering=True,
    TypeFilter=1)
geometry_pipeline_4 = GeometryPipeline(
    GroupByLayer=False,
    GroupByType=False,
    IncludeHidden=True,
    IncludeLocked=True,
    LayerFilter="*_FINESTRE",
    NameFilter="*",
    SublayerFiltering=True,
    TypeFilter=4)
geometry_pipeline_5 = GeometryPipeline(
    GroupByLayer=False,
    GroupByType=False,
    IncludeHidden=True,
    IncludeLocked=True,
    LayerFilter="*_CENTRO",
    NameFilter="*",
    SublayerFiltering=True,
    TypeFilter=4)
geometry_pipeline_6 = GeometryPipeline(
    GroupByLayer=False,
    GroupByType=False,
    IncludeHidden=True,
    IncludeLocked=True,
    LayerFilter="*_zip",
    NameFilter="*",
    SublayerFiltering=True,
    TypeFilter=4)
geometry_pipeline_7 = GeometryPipeline(
    GroupByLayer=False,
    GroupByType=False,
    IncludeHidden=True,
    IncludeLocked=True,
    LayerFilter="*_tagli",
    NameFilter="*",
    SublayerFiltering=True,
    TypeFilter=4)
# UNROLL
brep = Brep(<brep referenced from the Rhino model>)

# ---- group: LAYOUT
brep_2 = Brep()  # disabled
number_slider = Slider(924, range=0..10000)  # disabled
number_slider_2 = Slider(5480, range=0..10000)  # disabled
area = Area(Geometry=brep_2)  # -> Area, Centroid; disabled
bounding_box = BoundingBox(Content=flatten(brep_2), Plane=PlaneXY(0, 0, 0), UnionBox=True)  # -> Box, Box_2; disabled
area_2 = Area(Geometry=bounding_box.Box)  # -> Area, Centroid; disabled
vector_2pt = Vector2Pt(PointA=area_2.Centroid, PointB=area.Centroid, Unitize=False)  # -> Vector, Length; disabled
amplitude = Amplitude(Vector=vector_2pt.Vector, Amplitude=number_slider)  # disabled
move = Move(Geometry=brep_2, Motion=amplitude)  # -> Geometry, Transform; disabled
area_3 = Area(Geometry=move.Geometry)  # -> Area, Centroid; disabled
xy_plane = XYPlane(Origin=Point(0, 0, 0))  # disabled
project = Project(Geometry=area_3.Centroid, Plane=xy_plane)  # -> Geometry, Transform; disabled
unit_x = UnitX(Factor=number_slider_2)  # disabled
move_2 = Move(Geometry=project.Geometry, Motion=unit_x)  # -> Geometry, Transform; disabled

# ----
curve = Curve([geometry_pipeline_7, geometry_pipeline_6, geometry_pipeline_5, geometry_pipeline_4])
point = Point([geometry_pipeline_3, geometry_pipeline_2, geometry_pipeline])
deconstruct_brep = DeconstructBrep(Brep=brep)  # -> simplify(flatten(Faces)), Edges, Vertices
merge = Merge(Data1=point)
md_slider = MDSlider(SliderMode=0, slider_value=Point(0.5, 0.5, 0.5), x_domain=Domain(0, 1), y_domain=Domain(0, 1), z_domain=Domain(0, 1))
brep_3 = Brep(graft(brep))
tree_statistics = TreeStatistics(Tree=deconstruct_brep.Faces)  # -> Paths, Length, simplify(Count)

# ----
# Batute
number_slider_3 = Slider(400, range=0..1000)
geometry_pipeline_8 = GeometryPipeline(
    GroupByLayer=False,
    GroupByType=False,
    IncludeHidden=True,
    IncludeLocked=True,
    LayerFilter="*_seam",
    NameFilter="*",
    SublayerFiltering=True,
    TypeFilter=0)
end_points = EndPoints(Curve=geometry_pipeline_8)  # -> Start, End
divide_distance = DivideDistance(Curve=geometry_pipeline_8, Distance=number_slider_3)  # -> Points, Tangents, Parameters
cull_index = CullIndex(List=divide_distance.Points, Indices="0", Wrap=True)
center_box = CenterBox(Base=PlaneXY(0, 0, 0), X="25", Y="25", Z="25")  # -> flatten(Box)
colour_picker = ColourPicker(PickedColour=RGB(102, 255, 0))
sphere = Sphere(Base=cull_index, Radius="25")  # -> flatten(Sphere)
brep_brep = BrepBrep(BrepA=brep_3, BrepB=[center_box, sphere])  # -> flatten(Curves), Points
custom_preview = CustomPreview(Geometry=[center_box, sphere], Material=colour_picker)

curve_2 = Curve(brep_brep.Curves)
merge_2 = Merge(Data1=curve, Data3=curve_2)  # -> simplify(Result)
evaluate_surface = EvaluateSurface(Surface=reparameterize(deconstruct_brep.Faces), Point=md_slider)  # -> Point, Normal, UDirection, VDirection, Frame
series = Series(Start=0, Step=1, Count=tree_statistics.Length)  # -> simplify(flatten(Series))
unroll_polysurface = UnrollPolysurface(Polysurface=brep, Points=merge, Curves=merge_2)  # -> Unrolled, UnrolledPoints, UnrolledCurves
adjust_plane = AdjustPlane(Plane=evaluate_surface.Point, Normal=evaluate_surface.Normal)
amplitude_2 = Amplitude(Vector=adjust_plane, Amplitude=Slider(9, range=0..1000))
move_3 = Move(Geometry=adjust_plane, Motion=amplitude_2)  # -> Geometry, Transform
deconstruct_brep_2 = DeconstructBrep(Brep=unroll_polysurface.Unrolled)  # -> Faces, Edges, Vertices
colour_picker_2 = ColourPicker(PickedColour=RGB(227, 247, 0))
text = Text(Location=move_3.Geometry, Text=series, Size="150")  # -> simplify(Curves)
vector = Vector(simplify(graft(adjust_plane)))
brep_4 = Brep(simplify(graft(deconstruct_brep.Faces)))
join_curves = JoinCurves(Curves=deconstruct_brep_2.Edges, Preserve=False)
panel = Panel(unroll_polysurface.Unrolled)
custom_preview_2 = CustomPreview(Geometry=text, Material=colour_picker_2)
project_2 = Project(Curve=text, Brep=brep_4, Direction=vector)
curve_3 = Curve(flatten(project_2))
data = Data([join_curves, unroll_polysurface.UnrolledCurves, unroll_polysurface.UnrolledPoints])
panel_2 = Panel("7")
curve_4 = Curve([<curve referenced from the Rhino model> x16])
curve_5 = Curve(graft([<curve referenced from the Rhino model> x51]))
curve_6 = Curve(graft([<curve referenced from the Rhino model> x6]))
list_item = ListItem(List=curve_4, Index=0, Wrap=True)
divide_distance_2 = DivideDistance(Curve=curve_5, Distance="20", AddEnd=True)
flip_curve = FlipCurve(Curve=curve_4, Guide=list_item)  # -> Curve, Flag
divide_distance_3 = DivideDistance(Curve=curve_6, Distance="20", AddEnd=True)
list_length = ListLength(List=divide_distance_2)
list_length_2 = ListLength(List=divide_distance_3)
# Batute
panel_3 = Panel("5")
perp_frames = PerpFrames(Curve=curve_5, Count=list_length, Align=True)  # -> Frames, Parameters
divide_number = DivideNumber(Curve=flip_curve.Curve, Number=panel_3)
perp_frames_2 = PerpFrames(Curve=curve_6, Count=list_length_2, Align=True)  # -> Frames, Parameters
cull_index_2 = CullIndex(List=divide_number, Indices=["0", "-1"], Wrap=True)  # -> flatten(List)
colour_picker_3 = ColourPicker(PickedColour=RGB(104, 219, 26))
cylinder = Cylinder(Base=perp_frames.Frames, Radius="1", Length="12")
cylinder_2 = Cylinder(Base=perp_frames_2.Frames, Radius="1", Length="12")
circle_cnr = CircleCNR(Center=cull_index_2, Normal=Vector(0, 0, 1), Radius=Slider(9, range=1..20))
cap_holes = CapHoles(Brep=cylinder)
cap_holes_2 = CapHoles(Brep=cylinder_2)
geometry = Geometry(circle_cnr)
custom_preview_3 = CustomPreview(Geometry=geometry, Material=colour_picker_3)
