# Grasshopper definition linetype.gh (Grasshopper 1.0.8)

value_list = ValueList({"One": 1, "Two": 2, "Three": 2² - 1, "Four": Sqrt(16)}, selected="Three")
query_model_linetypes = QueryModelLinetypes(AutoUpdateState=True)
object_linetype = ObjectLinetype(Source=value_list, ModelLinetype=query_model_linetypes)  # -> Linetype, Source, ModelLinetype
get_geometry = GetGeometry(
    AnnotationTypeFilter=2430,
    AtLeast=1,
    AtMost=100,
    DeleteInput=False,
    Filter=4,
    Prompt="Select base profile curve",
    TreeAccess=True)
drafting_attributes = DraftingAttributes(Linetype=object_linetype.Linetype)  # -> Drafting, Linetype, LinetypeScale
query_model_linetypes_2 = QueryModelLinetypes(Name="400,2", AutoUpdateState=True)
model_object = ModelObject(Geometry=get_geometry, Drafting=drafting_attributes.Drafting)  # -> Object, Geometry, Name, Layer, Visibility, Display, Drafting, Render
drafting_attributes_2 = DraftingAttributes(Linetype=query_model_linetypes_2, LinetypeScale=Slider(1, range=1..100))  # -> Drafting, Linetype, LinetypeScale
model_object_2 = ModelObject(Object=model_object.Object, Drafting=drafting_attributes_2.Drafting)  # -> Object, Geometry, Name, Layer, Visibility, Display, Drafting, Render
unit_x = UnitX(Factor=1)
amplitude = Amplitude(Vector=unit_x, Amplitude="5000")
content_cache = ContentCache(Content=model_object_2.Object)
move = Move(Geometry=model_object_2.Object, Motion=amplitude)  # -> Geometry, Transform
context_bake = ContextBake(Content=move.Geometry)
