# Grasshopper definition polyline.gh (Grasshopper 1.0.8)

curve = Curve([<curve referenced from the Rhino model> x429])
panel = Panel("5")
geometry = Geometry([<point referenced from the Rhino model> x22, <curve referenced from the Rhino model> x445, <point referenced from the Rhino model>, <curve referenced from the Rhino model> x83, <point referenced from the Rhino model> x6, <curve referenced from the Rhino model> x76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])
curve_to_polyline = CurveToPolyline(Curve=curve, ToleranceDistance=Slider(0.1, range=0.1..5), ToleranceAngle=0)  # -> Polyline, Segments
geometry_2 = Geometry(curve_to_polyline.Polyline)
