# Grasshopper definition sew points.gh (Grasshopper 1.0.8)

curve = Curve([<curve referenced from the Rhino model> x4])
curve_2 = Curve([<curve referenced from the Rhino model> x10])
get_geometry = GetGeometry(
    AnnotationTypeFilter=2430,
    AtLeast=1,
    AtMost=100,
    DeleteInput=False,
    Filter=4,
    Prompt="Select base profile curve",
    TreeAccess=True)
relay = Relay([curve_2, curve, get_geometry])
list_item = ListItem(List=relay, Index=0, Wrap=True)
flip_curve = FlipCurve(Curve=relay, Guide=list_item)  # -> graft(Curve), Flag
curve_middle = CurveMiddle(Curve=flip_curve.Curve)
curve_closest_point = CurveClosestPoint(Point=curve_middle, Curve=flip_curve.Curve)  # -> Point, Parameter, Distance
unit_x = UnitX(Factor=1)
unit_x_2 = UnitX(Factor=1)
construct_plane = ConstructPlane(Origin=Point(0, 0, 0), XAxis=Vector(1, 0, 0), YAxis=Vector(0, 1, 0))
construct_plane_2 = ConstructPlane(Origin=Point(0, 0, 0), XAxis=Vector(1, 0, 0), YAxis=Vector(0, 1, 0))
# Batute
shatter = Shatter(Curve=flip_curve.Curve, Parameters=curve_closest_point.Parameter)
list_item_2 = ListItem(List=shatter, Index=0, Wrap=True)  # -> Item, Item1
line_sdl = LineSDL(Start=construct_plane, Direction=unit_x, Length=Slider(10, range=0..10))
line_sdl_2 = LineSDL(Start=construct_plane_2, Direction=unit_x_2, Length=Slider(10, range=0..10))
flip_curve_2 = FlipCurve(Curve=list_item_2.Item)  # -> Curve, Flag
divide_length = DivideLength(Curve=[list_item_2.Item1, flip_curve_2.Curve], Length="200")  # -> Points, Tangents, Parameters
# can text
curve_3 = Curve([<curve referenced from the Rhino model> x6])
# Zip text
curve_4 = Curve([<curve referenced from the Rhino model> x8])
removeduplicatepts = RemoveDuplicatePts(Points=[divide_length.Points, curve_middle], Tolerance=0.01)  # -> flatten(UniquePoints)
cull_duplicates = CullDuplicates(Points=removeduplicatepts, Tolerance=0.1, CullMode=3)  # -> Points, Indices, Valence
flip_curve_3 = FlipCurve(Curve=curve_3, Guide=line_sdl)  # -> Curve, Flag
evaluate_curve = EvaluateCurve(Curve=reparameterize(flip_curve_3.Curve), Parameter="0.5")  # -> Point, Tangent, Angle
curve_middle_2 = CurveMiddle(Curve=flip_curve_3.Curve)
flip_curve_4 = FlipCurve(Curve=curve_4, Guide=line_sdl_2)  # -> Curve, Flag
evaluate_curve_2 = EvaluateCurve(Curve=reparameterize(flip_curve_4.Curve), Parameter="0.5")  # -> Point, Tangent, Angle
curve_middle_3 = CurveMiddle(Curve=flip_curve_4.Curve)
construct_plane_3 = ConstructPlane(Origin=curve_middle_2, XAxis=evaluate_curve.Tangent, YAxis=Vector(0, 1, 0))
construct_plane_4 = ConstructPlane(Origin=curve_middle_3, XAxis=evaluate_curve_2.Tangent, YAxis=Vector(0, 1, 0))
circle_cnr = CircleCNR(Center=cull_duplicates.Points, Normal=Vector(0, 0, 1), Radius=Slider(2, range=1..20))
length = Length(Curve=curve_3)
length_2 = Length(Curve=curve_4)
colour_picker = ColourPicker(PickedColour=RGB(255, 255, 255))
round = Round(Number=length)  # -> Nearest, Floor, Ceiling
round_2 = Round(Number=length_2)  # -> Nearest, Floor, Ceiling
geometry = Geometry(circle_cnr)
panel = Panel("zip {0}")
group = Group(Geometry=geometry)  # -> flatten(Group)
format = Format(Format="can", Culture=127, Data0=round.Nearest)
format_2 = Format(Format="zip ", Culture=127, Data0=round_2.Nearest)
context_bake = ContextBake(Content=group)
custom_preview = CustomPreview(Geometry=geometry, Material=colour_picker)
panel_3 = Panel(format)
panel_4 = Panel(format_2)
text_tag_3d = TextTag3D(Location=construct_plane_3, Text=format, Size=Slider(2, range=0..100), Justification=7)
text_tag_3d_2 = TextTag3D(Location=construct_plane_4, Text=format_2, Size=Slider(2, range=0..100), Justification=7)
